# Dynamo graph Place Family Type by Points From Topography.dyn (Dynamo 2.10.1.3976)

# group: Select Topography
select_model_element = DSModelElementSelection()  # nothing selected
points = Topography.Points(topography=select_model_element)
watch = Watch(points)

transpose = List.Transpose(lists=watch)

# group: X
number = DoubleInput(0)
getItemAtIndex = List.GetItemAtIndex(list=transpose, index=number)
boolean = BoolSelector(true)
clean = List.Clean(list=getItemAtIndex, preserveIndices=boolean, lacing=Longest)

# group: Y
number_2 = DoubleInput(1)
getItemAtIndex_2 = List.GetItemAtIndex(list=transpose, index=number_2)
boolean_2 = BoolSelector(true)
clean_2 = List.Clean(list=getItemAtIndex_2, preserveIndices=boolean_2)

# group: Z
number_3 = DoubleInput(2)
getItemAtIndex_3 = List.GetItemAtIndex(list=transpose, index=number_3)
boolean_3 = BoolSelector(true)
clean_3 = List.Clean(list=getItemAtIndex_3, preserveIndices=boolean_3)

# group: Place a Family Type by Points from CSV File
family_types = FamilyTypes("RPC Tree - Deciduous:Schumard Oak - 30'")
byCoordinates = FamilyInstance.ByCoordinates(familyType=family_types, x=clean, y=clean_2, z=clean_3)
watch_2 = Watch(byCoordinates)

byCoordinates_2 = Point.ByCoordinates(x=clean, y=clean_2, z=clean_3)  # graph output
watch_3 = Watch(byCoordinates_2)
