# Dynamo graph Random Family Deleter.dyn (Dynamo 2.10.1.3976)
# packages: Clockwork for Dynamo 1.x 1.31.1, Crumple 2022.5.27

seed_value_as_integer = CodeBlock { 0; }

# group: Deletes Random Elements from a Selection of Family Types
family_types = FamilyTypes("RPC Tree - Deciduous:Hawthorn - 25'")
all_elements_of_family_type = ElementsOfFamilyType(Family_Type=family_types)
code_block = CodeBlock(a=all_elements_of_family_type) { [a,b,c]; }  # unwired: b, c
the_amount_you_want_to_delete = CodeBlock { 3000; }
randomElements = Custom[List.RandomElements](baseElements=code_block, amount=the_amount_you_want_to_delete, seed=seed_value_as_integer, lacing=Shortest)  # package Clockwork for Dynamo 1.x; Creates a list of random elements based on a given list of elements

# group: The Elements to be Deleted
watch = Watch(randomElements)
elements_delete = Custom[© Elements.Delete](elements=watch)  # package Crumple; Given a list of elements, attempt to delete them and then return true or false depending on whether it could be deleted. This script flattens the list structure before attempting.

# group: Did it delete the elements?
watch_2 = Watch(elements_delete.results)
watch_3 = Watch(elements_delete.failed)
