# Dynamo graph Walls by Revit Mass.dyn (Dynamo 2.10.1.3976)

# group: Walls by Mass
string = StringInput("Finish Face: Exterior")
wall_types = WallTypes("Exterior CMU + 7/8\" Stucco")
categories = Categories("OST_Mass")
all_elements_of_category = ElementsOfCategory(Category=categories)
faces = Element.Faces(element=all_elements_of_category)
byFace = Wall.ByFace(locationLine=string, wallType=wall_types, surface=faces)  # frozen
watch = Watch(byFace)

sum = Math.Sum(values=watch)

# group: Floors
levels = Levels("1")
categories_2 = Categories("OST_MassFloor")
all_elements_of_category_2 = ElementsOfCategory(Category=categories_2)
curves = Element.Curves(element=all_elements_of_category_2)
floor_types = FloorTypes()  # nothing selected
levels_2 = Levels("0")
byOutlineTypeAndLevel = Floor.ByOutlineTypeAndLevel(outlineCurves=curves, floorType=floor_types, level=levels_2)  # frozen
byOutlineTypeAndLevel_2 = Floor.ByOutlineTypeAndLevel(outlineCurves=curves)  # unwired: floorType, level
levels_3 = Levels("2")
byOutlineTypeAndLevel_3 = Floor.ByOutlineTypeAndLevel(outlineCurves=curves, level=levels_3)  # unwired: floorType
byOutlineTypeAndLevel_4 = Floor.ByOutlineTypeAndLevel(outlineCurves=curves)  # unwired: floorType, level

# group: Roof
categories_3 = Categories("OST_Mass")
all_elements_of_category_3 = ElementsOfCategory(Category=categories_3)
faces_2 = Element.Faces(element=all_elements_of_category_3)
roof_types = RoofTypes("Exterior TPO ROOFING")
levels_4 = Levels("2")

perimeterCurves = Surface.PerimeterCurves(surface=faces_2)

# group (continued): Roof
byOutlineTypeAndLevel_5 = Roof.ByOutlineTypeAndLevel(outline=perimeterCurves, roofType=roof_types, level=levels_4)

watch_2 = Watch(byOutlineTypeAndLevel_5)
watch_3 = Watch(byOutlineTypeAndLevel)
watch_4 = Watch(byOutlineTypeAndLevel_2)
watch_5 = Watch(byOutlineTypeAndLevel_3)
watch_6 = Watch(byOutlineTypeAndLevel_4)
