# Dynamo graph Workset Creator.dyn (Dynamo 2.12.1.8246)
# packages: Genius Loci 2022.8.5, archi-lab.net 2018.0.8, Crumple 2022.5.27

code_block = CodeBlock { "Architecture"; "Structure"; "Interior"; "Site"; "Landscape"; "Mechanical"; "Electrical"; "Plumbing"; "Entourage"; }
list_create = List.Create(item0=code_block.out0, item1=code_block.out1, item2=code_block.out2, item3=code_block.out3, item4=code_block.out4, item5=code_block.out5, item6=code_block.out6, item7=code_block.out7, item8=code_block.out8)
flatten = List.Flatten(list=list_create)
create_workset = Custom[Create Workset](name=flatten)  # package Genius Loci
watch = Watch(create_workset.Workset)
worksets_create = Custom[© Worksets.Create](name=flatten)  # package Crumple; Attempts to create worksets given a provided name. Will return whether it was successful in each case, as well as the new workset's Id where it was (and a null where it wasn't).
watch_2 = Watch(worksets_create.workset)
worksets_create_python2 = Custom[© Worksets.Create.Python2](name=flatten)
watch_3 = Watch(worksets_create_python2.success)
watch_4 = Watch(list_create)
worksets_create_python2_2 = Custom[© Worksets.Create.Python2](name=flatten)
watch_5 = Watch(worksets_create_python2_2.workset)
watch_6 = Watch(worksets_create_python2_2.id)
watch_7 = Watch(worksets_create_python2_2.success)
byName = archilab.Revit.Elements.Workset.ByName(name=flatten)
watch_8 = Watch(byName)
